# Grasshopper definition Sumer-Lec4.gh (Grasshopper 1.0.7)

# ---- group: RH_IN:size of nubbins
number_slider = Slider(2, range=0..5)

# ---- group: RH_IN:subd on/off
number_slider_2 = Slider(2, range=1..2)

# ---- group: RH_IN:quantity
number_slider_3 = Slider(5, range=4..7)

# ---- group: RH_IN:size
number_slider_4 = Slider(17, range=5..25)

# ----
point = Point(Point(0, 0, 0))
subtraction = Subtraction(A=number_slider_3, B="2")
sphere = Sphere(Base=point, Radius=Slider(50, range=0..100))
divide_domain² = DivideDomain²(Domain=sphere, UCount=number_slider_3, VCount=subtraction)
isotrim = Isotrim(Surface=sphere, Domain=divide_domain²)
deconstruct_brep = DeconstructBrep(Brep=isotrim)  # -> Faces, Edges, Vertices
area = Area(Geometry=deconstruct_brep.Faces)  # -> Area, Centroid
surface_closest_point = SurfaceClosestPoint(Point=area.Centroid, Surface=deconstruct_brep.Faces)  # -> Point, UVPoint, Distance
evaluate_surface = EvaluateSurface(Surface=deconstruct_brep.Faces, Point=surface_closest_point.UVPoint)  # -> Point, Normal, UDirection, VDirection, Frame
amplitude = Amplitude(Vector=evaluate_surface.Normal, Amplitude=number_slider_4)
move = Move(Geometry=evaluate_surface.Point, Motion=amplitude)  # -> Geometry, Transform
division = Division(A=move.Geometry, B=Slider(5, range=5..10))
extrude_point = ExtrudePoint(Base=deconstruct_brep.Faces, Point=move.Geometry)
deconstruct_brep_2 = DeconstructBrep(Brep=extrude_point)  # -> Faces, Edges, Vertices
curve_middle = CurveMiddle(Curve=deconstruct_brep_2.Edges)
line = Line(StartPoint=surface_closest_point.Point, EndPoint=move.Geometry)
number_slider_5 = Slider(0.1, range=0..0.1)
number_slider_6 = Slider(0.07, range=0..0.1)
point_list = PointList(Points=curve_middle, Size=Slider(1, range=0..1))
panel = Panel("""5
3
4""")
mesh = Mesh(extrude_point)
sphere_2 = Sphere(Base=move.Geometry, Radius=number_slider)
quad_remesh = QuadRemesh(Mesh=mesh, Settings={aqc=True, as=50, dhe=True, gci=0, null=False, pme=0, sa=0, tqc=2000})
subd_from_mesh = SubDFromMesh(Mesh=quad_remesh, Creases=number_slider_2, Corners=1, Interpolate=False)

# ---- group: RH_OUT:mesh
mesh_2 = Mesh([subd_from_mesh, sphere_2])
