# Grasshopper definition paintNormal.gh (Grasshopper 1.0.7)

# ---- group: RH_IN:mesh
mesh = Mesh()

# ----
demesh = DeconstructMesh(Mesh=mesh)  # -> Vertices, Faces, Colours, Normals
mcol = MeshColours(Mesh=mesh, Colours=demesh.Normals)

# ---- group: RH_OUT:mesh
mesh_2 = Mesh(mcol)
